# Grasshopper definition build.gh (Grasshopper 1.0.7)
# plug-ins: Firefly.X

file = ReadFile(File="C:\Users\Ozguc Capunaman\Documents\GitHub\InteractiveDigitalFabrication\py\ghPython.py", PerLineParse=False)
geo = Geometry(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)
timer = Timer(TimerInterval=1, Target=[udp_listener, udp_sender])
udp_listener = UDPListener(Port="5005")
button = Button()
pt = Point(Point(2000, 0, 500))
python = GhPythonScript(Code=file, RUN=Toggle(True), RESET=button, Init_geo=geo, Udp_in=udp_listener, WObj=pt)  # -> Out, Udp_out, Pc
udp_sender = UDPSender(Data=python.Udp_out, IPAddressOfUDPServer="127.0.0.1", UDPPort="5004")

len = TextLength(Text=udp_listener)
equals = Equality(FirstNumber=len, SecondNumber=0)  # -> Equality, Inequality
dispatch = Dispatch(List=udp_listener, DispatchPattern=equals.Inequality)  # -> ListA, ListB
len_2 = TextLength(Text=python.Udp_out)  # disabled
rec = DataRecorder(dispatch.ListA, DataLimit=-10, RecordData=True)
equals_2 = Equality(FirstNumber=len_2, SecondNumber=0)  # -> Equality, Inequality; disabled
panel = Panel(rec)
dispatch_2 = Dispatch(List=python.Udp_out, DispatchPattern=equals_2.Inequality)  # -> ListA, ListB; disabled
rec_2 = DataRecorder(python.Out, DataLimit=-10, RecordData=True)
rec_3 = DataRecorder(dispatch_2.ListA, DataLimit=-10, RecordData=True)  # disabled
panel_2 = Panel(rec_3)  # disabled
panel_3 = Panel(rec_2)

python_2 = GhPythonScript(pts=python.Pc)  # -> a, b; inputs pts: list, WObj: Point3d
# ---------- python_2: Python ----------
__author__ = "Ozguc Capunaman"
__version__ = "2019.03.09"

import rhinoscriptsyntax as rs
import math

def shift(seq, n):
    for i in range(n):
        seq.append(seq.pop(0))
    return seq

def matchWObj(geoList, target):
    ref = rs.AddPoint(0,0,0)
    vec = rs.VectorCreate(target, ref)
    rot = rs.RotateObjects(geoList, rs.AddPoint(0,0,0), -90, copy=True)
    return rs.CopyObjects(rot, vec)

def dividePtCloud(points):
    ptList = []
    for i in range(len(points)):
        if i == 0:
            tmp = []
        elif i == len(points)-1:
            tmp.append(points[i])
            ptList.append(tmp)
        else:
            tmp.append(points[i])
            _,_,curZ = rs.PointCoordinates(points[i])
            _,_,nextZ = rs.PointCoordinates(points[i+1])
            distZ = curZ - nextZ
            if distZ < -50:
                ptList.append(tmp)
                tmp = []
    return ptList
    
def divideLR(ptList):
    Llist = rs.CopyObjects(ptList[0:][::2])
    Rlist = rs.CopyObjects(ptList[1:][::2])
    shift(Rlist, 4)
    return Llist, Rlist
    
def mergeLR(Llist, Rlist):
    assert(len(Llist) == len(Rlist))
    mergedList = []
    for i in range(len(Llist)):
        if rs.CurveLength(Llist[i]) >= rs.CurveLength(Rlist[i]):
            mergedList.append(rs.CopyObject(Llist[i]))
        else:
            mergedList.append(rs.CopyObject(Rlist[i]))
    return mergedList

def createLines(ptList, rebuildCount = 10, degree = 3 ):
    crvList = []
    for i in range(len(ptList)):
         crv = rs.AddInterpCurve(ptList[i])
         rs.RebuildCurve(crv, degree,rebuildCount)
         crvList.append(crv)
    return crvList
    
def offsetCurves(crvList, offsetFactor=5):
    result = []
    for i in range(len(crvList)):
        x,y,_ = rs.CurveEndPoint(crvList[i])
        vec = rs.VectorCreate((0,0,0),(x,y,0))
        unitVec = rs.VectorUnitize(vec)
        scaledVec = rs.VectorScale(unitVec, offsetFactor)
        tmp = rs.CopyObject(crvList[i], scaledVec)
        result.append(tmp)
    return result
    
def reconSrf(crvList):
    return rs.AddLoftSrf(crvList, closed = True)

def getExtendedCrv(crvList, dist=50, layer_height=2.5, vecMul = .66):
    segmentCount = int(math.floor(dist / layer_height)) - 1
    tmpList = []
    for i in range(len(crvList)):
        extendedCrv = rs.ExtendCurveLength(crvList[i], 2, 0, dist)
        domStart, domEnd = rs.CurveDomain(extendedCrv)
        trimmedCrv = rs.TrimCurve(extendedCrv, (domStart, 0))
        tmpList.append(trimmedCrv)
    tmp = []
    ###Smooth Curves###
    for i in range(len(tmpList)):
        bottomPt = rs.CurveEndPoint(tmpList[i])
        zVec = rs.VectorAdd((0,0,0),(0,0,dist))
        topPt = rs.CopyObject(bottomPt, zVec)
        line = rs.AddLine(bottomPt, topPt)
        crvPts = rs.DivideCurve(tmpList[i], segmentCount)
        LinePts = rs.DivideCurve(line, segmentCount)
        for i in range(segmentCount):
            tmpVec = rs.VectorCreate(LinePts[segmentCount-i-1], crvPts[i])
            tmpVec = rs.VectorScale(tmpVec, vecMul)
            rs.MoveObject(crvPts[i], tmpVec)
        tmp.append(rs.AddInterpCurve(crvPts))
        result = []
        for crv in tmp:
            crvLen = rs.CurveLength(crv)
            if crvLen < dist:
                tmpExt = dist-crvLen
                result.append(rs.ExtendCurveLength(crv, 2, 0, tmpExt))
            else:
                result.append(rs.CopyObject(crv))
    return result
    
def getExtendedTP(crvList, dist=50, layer_height=2.5):
    result = []
    ptsList = []
    lenList = []
    segmentCount = math.floor(dist / layer_height)
    for crv in crvList:
        tmp = rs.DivideCurve(crv, segmentCount)
        lenList.append(len(tmp))
        ptsList.append(tmp)
    for i in range(min(lenList)):
        tmp = []
        for j in range(len(ptsList)):
            tmp.append(ptsList[j][i])
        tmp.append(ptsList[0][i])
        tmpCrv = rs.AddInterpCurve(tmp, knotstyle=3)
        result.append(tmpCrv)
    result.reverse()
    return result
    
def interpolateTP(ptCloud):
    ptList = dividePtCloud(ptCloud)
    crvL, crvR = divideLR(createLines(ptList, 5))
    crvMerged = mergeLR(crvL, crvR)[0:][::2]
    offCrv = offsetCurves(crvMerged)
    WObjCrv = matchWObj(offCrv, WObj)
    srf = reconSrf(WObjCrv)
    extCrv = getExtendedCrv(WObjCrv)
    extTP = getExtendedTP(extCrv)
    return srf, extTP

a, b = interpolateTP(pts)
# ---------- end python_2 ----------
timer_2 = Timer(TimerInterval=250, Target=listtotree)  # disabled
python_3 = GhPythonScript()  # -> out, a; disabled
# ---------- python_3: Python ----------
__author__ = "Ozguc Capunaman"
__version__ = "2019.04.15"

import rhinoscriptsyntax as rs
from Grasshopper.Kernel import GH_Convert

print(x)
a = GH_Convert.ToGHGuid_Secondary(x, None)
# ---------- end python_3 ----------
listtotree = GhPythonScript(RESET=button)  # -> flatten(ghObj); inputs pyList: list; disabled
# ---------- listtotree: Python ----------
__author__ = "Ozguc Capunaman"
__version__ = "2019.04.15"

import rhinoscriptsyntax as rs

import Rhino.Geometry as rg
from clr import AddReference as addr
addr("Grasshopper")

from System import Object
from Grasshopper import DataTree
from Grasshopper.Kernel.Data import GH_Path
from Grasshopper.Kernel import GH_Convert
import scriptcontext as sc

key = "deg"

def rotate(geoList, deg):
    result = []#DataTree[object]()
    for i in range(len(geoList)):
        tmp = rs.RotateObject(geoList[i], rs.AddPoint(0,0,0), deg, copy=True)
        print(tmp)
        result.append(tmp)#Add(tmp)
    return result

if len(pyList) != 0 and pyList[0] != None:
    if sc.sticky.has_key(key):
    	deg = sc.sticky[key]
    	deg += 6
    	if deg >= 360:
    	    deg -= 360
    else:
    	sc.sticky[key] = 0
    if RESET:
        sc.sticky[key] = 0
    
    sc.sticky[key] = deg
    ghObj = rotate(pyList, deg)
# ---------- end listtotree ----------
swatch = ColourSwatch(SwatchColor=RGB(181, 181, 181))  # disabled
material = CreateMaterial(Diffuse=swatch, Specular=RGB(255, 255, 255), Emission=RGB(0, 0, 0), Transparency=0, Shine=0)  # disabled
preview = CustomPreview(Material=material)  # disabled
