# Grasshopper definition processPointCloud3.gh (Grasshopper 1.0.7)

dir = FilePath("C:\Users\Ozguc Capunaman\Documents\GitHub\InteractiveDigitalFabrication\sessions\20190501-2106_\20190501-2106-scan0.xyz")
python = GhPythonScript(x=dir)  # -> out, a
# ---------- python: Python ----------
__author__ = "Ozguc Capunaman"
__version__ = "2019.04.19"

import rhinoscriptsyntax as rs
import os

def xyz2pts(FN):
		filepath = FN
		if(os.path.exists(filepath)):
			result = []
			with open(filepath) as fp:  
			   line = fp.readline()
			   while line:
				   curLine = line.strip()
				   coord = curLine.split(' ')
				   for i in range(len(coord)):
					   coord[i] = float(coord[i])
				   result.append(rs.AddPoint(coord))
				   line = fp.readline()
			return result
		else:
			raise Exception('File doesn\'t exist!')
			
a = xyz2pts(x)
# ---------- end python ----------
pt = Point(Point(0, 0, 0))
python_2 = GhPythonScript(pts=python.a, WObj=pt, x=Slider(1.2, range=0..1.2))  # -> a, b; inputs pts: list, WObj: Point3d
# ---------- python_2: Python ----------
__author__ = "Ozguc Capunaman"
__version__ = "2019.03.09"

import rhinoscriptsyntax as rs
import math

def shift(seq, n):
    for i in range(n):
        seq.append(seq.pop(0))
    return seq

def matchWObj(geoList, target):
    ref = rs.AddPoint(0,0,0)
    vec = rs.VectorCreate(target, ref)
    rot = rs.RotateObjects(geoList, rs.AddPoint(0,0,0), -90, copy=True)
    return rs.CopyObjects(rot, vec)

def dividePtCloud(points):
    ptList = []
    for i in range(len(points)):
        if i == 0:
            tmp = []
        elif i == len(points)-1:
            tmp.append(points[i])
            ptList.append(tmp)
        else:
            tmp.append(points[i])
            _,_,curZ = rs.PointCoordinates(points[i])
            _,_,nextZ = rs.PointCoordinates(points[i+1])
            distZ = curZ - nextZ
            if distZ < -25:
                ptList.append(tmp)
                tmp = []
    return ptList

def dist(pt0, pt1):
        return rs.Distance(pt0, pt1)

def clean(ptList):
    result = []
    for list in ptList:
        bin = []
        tmp = []
        tmplen = len(list)
#        print(tmplen)
        for i in range(len(list)):
            if i ==0:
                tmp.append(list[i])
            else:
                if dist(list[i-1], list[i]) > 10:
                    bin.append(tmp)
                    tmp = []
                tmp.append(list[i])
        bin.append(tmp)
        tmpResult = []
        for b in bin:
            if len(b) > len(tmpResult):
                tmpResult = b
        result.append(tmpResult)
#        print len(tmpResult)
#        print "-------"
    return result
    
def divideLR(ptList):
    Llist = rs.CopyObjects(ptList[0:][::2])
    Rlist = rs.CopyObjects(ptList[1:][::2])
    shift(Rlist, 4)
    return Llist, Rlist
    
def mergeLR(Llist, Rlist):
#    assert(len(Llist) == len(Rlist))
    mergedList = []
    for i in range(len(Llist)):
        if rs.CurveLength(Llist[i]) >= rs.CurveLength(Rlist[i]):
            mergedList.append(rs.CopyObject(Llist[i]))
        else:
            mergedList.append(rs.CopyObject(Rlist[i]))
    return mergedList

def createLines(ptList, rebuildCount = 10, degree = 3 ):
    crvList = []
    for i in range(len(ptList)):
         crv = rs.AddInterpCurve(ptList[i])
         rs.RebuildCurve(crv, degree,rebuildCount)
         crvList.append(crv)
    return crvList
    
def offsetCurves(crvList, offsetFactor=0):
    result = []
    for i in range(len(crvList)):
        x,y,_ = rs.CurveEndPoint(crvList[i])
        vec = rs.VectorCreate((0,0,0),(x,y,0))
        unitVec = rs.VectorUnitize(vec)
        scaledVec = rs.VectorScale(unitVec, offsetFactor)
        tmp = rs.CopyObject(crvList[i], scaledVec)
        result.append(tmp)
    return result
    
def reconSrf(crvList):
    return rs.AddLoftSrf(crvList, loft_type=3, simplify_method=0, closed = True)

def getExtendedCrv(crvList, dist=50, layer_height=2.5, vecMul = .66):
    segmentCount = int(math.floor(dist / layer_height)) - 1
    tmpList = []
    for i in range(len(crvList)):
        extendedCrv = rs.ExtendCurveLength(crvList[i], 2, 0, dist)
        domStart, domEnd = rs.CurveDomain(extendedCrv)
        trimmedCrv = rs.TrimCurve(extendedCrv, (domStart, 0))
        tmpList.append(trimmedCrv)
    tmp = []
    ###Smooth Curves###
    for i in range(len(tmpList)):
        bottomPt = rs.CurveEndPoint(tmpList[i])
        zVec = rs.VectorAdd((0,0,0),(0,0,dist))
        topPt = rs.CopyObject(bottomPt, zVec)
        line = rs.AddLine(bottomPt, topPt)
        crvPts = rs.DivideCurve(tmpList[i], segmentCount)
        LinePts = rs.DivideCurve(line, segmentCount)
        for i in range(segmentCount):
            tmpVec = rs.VectorCreate(LinePts[segmentCount-i-1], crvPts[i])
            tmpVec = rs.VectorScale(tmpVec, vecMul)
            rs.MoveObject(crvPts[i], tmpVec)
        tmp.append(rs.AddInterpCurve(crvPts))
        result = []
        for crv in tmp:
            crvLen = rs.CurveLength(crv)
            if crvLen < dist:
                tmpExt = dist-crvLen
                result.append(rs.ExtendCurveLength(crv, 2, 0, tmpExt))
            else:
                result.append(rs.CopyObject(crv))
    return result
    
def getExtendedTP(crvList, dist=50, layer_height=2.5):
    result = []
    ptsList = []
    lenList = []
    segmentCount = math.floor(dist / layer_height)
    for crv in crvList:
        tmp = rs.DivideCurve(crv, segmentCount)
        lenList.append(len(tmp))
        ptsList.append(tmp)
    for i in range(min(lenList)):
        tmp = []
        for j in range(len(ptsList)):
            tmp.append(ptsList[j][i])
        tmp.append(ptsList[0][i])
        tmpCrv = rs.AddInterpCurve(tmp, knotstyle=3)
        result.append(tmpCrv)
    result.reverse()
    return result
    
def interpolateTP(ptCloud):
    ptList = dividePtCloud(ptCloud)
    ptList = clean(ptList)
    crvL, crvR = divideLR(createLines(ptList, 5))
    crvMerged = mergeLR(crvL, crvR)#[0:][::2]
    offCrv = offsetCurves(crvMerged)
    WObjCrv = matchWObj(crvMerged, WObj)
    srf = reconSrf(WObjCrv)
    extCrv = getExtendedCrv(WObjCrv, vecMul = x)
    srf2 = reconSrf(extCrv)
    return srf, srf2

a, b = interpolateTP(pts)
# ---------- end python_2 ----------
number_slider = Slider(0.1, range=0..1)
number_slider_2 = Slider(25, range=0..100)
material = CreateMaterial(
    Diffuse=ColourSwatch(SwatchColor=RGB(181, 181, 181)),
    Specular=RGB(255, 255, 255),
    Emission=RGB(0, 0, 0),
    Transparency=number_slider,
    Shine=number_slider_2)
material_2 = CreateMaterial(
    Diffuse=ColourSwatch(SwatchColor=RGB(104, 206, 40)),
    Specular=RGB(255, 255, 255),
    Emission=RGB(0, 0, 0),
    Transparency=number_slider,
    Shine=number_slider_2)
preview = CustomPreview(Geometry=python_2.b, Material=material_2)
preview_2 = CustomPreview(Geometry=python_2.a, Material=material)
